# Grasshopper definition WatchCharger.gh (Grasshopper 1.0.7)

vec = VectorXYZ(XComponent=Slider(0, range=0..100), YComponent=Slider(0, range=0..100), ZComponent=Slider(15, range=0..100))  # -> Vector, Length
vec_2 = VectorXYZ(XComponent=Slider(30, range=0..100), YComponent=Slider(50, range=0..100), ZComponent=Slider(100, range=0..100))  # -> Vector, Length
vec_3 = VectorXYZ(XComponent=Slider(15, range=-100..100), YComponent=Slider(-30, range=-100..100), ZComponent=Slider(0, range=-100..100))  # -> Vector, Length
vec_4 = VectorXYZ(
    XComponent=Slider(-40, range=-100..100),
    YComponent=Slider(-40, range=-100..100),
    ZComponent=Slider(-22, range=-100..100))  # -> Vector, Length
vec_5 = VectorXYZ(XComponent=Slider(50, range=0..100), YComponent=Slider(50, range=0..100), ZComponent=Slider(15, range=0..100))  # -> Vector, Length
base_radius = Slider(40, range=1..100)
pt = Point(vec_2.Vector)
pt_2 = Point(vec_3.Vector)
pt_3 = Point(vec_4.Vector)
pt_4 = Point(vec_5.Vector)
pt_5 = Point(vec.Vector)
box = Box2Pt(PointA=pt_3, PointB=pt_4, Plane=PlaneXY(0, 0, 0))
sph = Sphere(Base=PlaneXY(0, 0, 0), Radius=base_radius)
cap = CapHoles(Brep=sph)
cyl = Cylinder(Base=pt_5, Radius=Slider(25, range=1..100), Length=Slider(40, range=1..100))
box_2 = Box2Pt(PointA=pt_2, PointB=pt, Plane=PlaneXY(0, 0, 0))
cap_2 = CapHoles(Brep=cyl)
sint = SolidIntersection(BrepsA=cap, BrepsB=box)
sdiff = SolidDifference(BrepsA=cap_2, BrepsB=box_2)
edges = BrepEdges(Brep=sdiff)  # -> Naked, Interior, NonManifold
boundary = BoundarySurfaces(Edges=edges.Interior)
srf = Surface(boundary)
area = Area(Geometry=srf)  # -> Area, Centroid
pt_6 = Point(area.Centroid)
charger_thickness = Slider(8.3, range=1..100)
charger_radius = Slider(14, range=1..100)
pl_origin = PlaneOrigin(Base=srf, Origin=pt_6)
charger = Cylinder(Base=pl_origin, Radius=charger_radius, Length=charger_thickness)
cap_3 = CapHoles(Brep=charger)
division = Division(A=charger_thickness, B=Slider(2, range=1..3))
box_3 = CenterBox(Base=pl_origin, X=Slider(5, range=0..30), Y=Slider(15, range=0..30), Z=division)
multiplication = Multiplication(A=division, B=Slider(-1, range=-3..3))
charger_angle = Slider(0, range=0..360)
vec_6 = VectorXYZ(XComponent=multiplication, YComponent=Slider(0, range=-5..30), ZComponent=Slider(5, range=0..30))  # -> Vector, Length
move = Move(Geometry=box_3, Motion=vec_6.Vector)  # -> Geometry, Transform
sunion = SolidUnion(Breps=[cap_3, move.Geometry])
multiplication_2 = Multiplication(A=charger_angle, B=Slider(0.01745, range=0..0.02))
rotate = Rotate(Geometry=sunion, Angle=multiplication_2, Plane=pl_origin)  # -> Geometry, Transform
sdiff_2 = SolidDifference(BrepsA=sdiff, BrepsB=rotate.Geometry)
sunion_2 = SolidUnion(Breps=[sint, sdiff_2])
preview = CustomPreview(
    Geometry=sunion_2,
    Material={diffuse=RGB(228, 178, 227), emission=RGB(68, 53, 68), shine=0.5, specular=RGB(255, 254, 254), transparency=0})
